# Dynamo graph CreateGenericAnnoTagsAtAreaLocs.dyn (Dynamo 1.0.0.1180)

# group: GET AREA COORDINATES
categories = Categories("Areas")
all_elements_of_category = ElementsOfCategory(categories)
watch = Watch(all_elements_of_category)
parameters = Element.Parameters(all_elements_of_category)
code_block = CodeBlock { "Area Type"; }
getParameterValueByName = Element.GetParameterValueByName(element=all_elements_of_category, parameterName=code_block)
code_block_2 = CodeBlock { "Floor Area"; }
eq = getParameterValueByName == code_block_2
filterByBoolMask = List.FilterByBoolMask(list=all_elements_of_category, mask=eq)
parameters_2 = Element.Parameters(filterByBoolMask.in)
get_area_positions = Python(IN[0]=filterByBoolMask.in)
# ---------- get_area_positions.python (29 lines) ----------
import clr
clr.AddReference('ProtoGeometry')
from Autodesk.DesignScript.Geometry import *

clr.AddReference('RevitAPI')
from Autodesk.Revit.DB import *

clr.AddReference("RevitNodes")
import Revit
clr.ImportExtensions(Revit.GeometryConversion)


#The inputs to this node will be stored as a list in the IN variables.
items = UnwrapElement(IN[0])

ptList = list()


for item in items:
	try:
		loc = item.Location
		if loc.ToString() == 'Autodesk.Revit.DB.LocationPoint':
			ptList.append(loc.Point.ToPoint())
			
	except:
		ptList.append("")

#Assign your output to the OUT variable.
OUT = ptList
# ----------------------------------------
code_block_3 = CodeBlock { "Level"; }
getParameterValueByName_2 = Element.GetParameterValueByName(element=filterByBoolMask.in, parameterName=code_block_3)

# group: GET VIEWS TO PLACE TAGS ON
element_types = ElementTypes("ViewPlan")
all_elements_of_type = ElementsOfType(element_types)
code_block_4 = CodeBlock { "Type"; "Floor Plan"; }
filterByParameterValue = Custom[List.FilterByParameterValue](Element=all_elements_of_type, parameterNameToFilter=code_block_4.out0, parameterValueToFilter=code_block_4.out1)  # Filters a List based on a given Parameter Value
parameters_3 = Element.Parameters(filterByParameterValue)
code_block_5 = CodeBlock { "ViewClassification"; "AreaTag"; }
filterByParameterValue_2 = Custom[List.FilterByParameterValue](Element=filterByParameterValue, parameterNameToFilter=code_block_5.out0, parameterValueToFilter=code_block_5.out1)
code_block_6 = CodeBlock { "Associated Level"; }
getParameterValueByName_3 = Element.GetParameterValueByName(element=filterByParameterValue_2, parameterName=code_block_6)
allIndicesOf = List.AllIndicesOf(list=getParameterValueByName_3, item=getParameterValueByName_2)
flatten = Flatten(allIndicesOf)
getItemAtIndex = List.GetItemAtIndex(list=filterByParameterValue_2, index=flatten)

family_types = FamilyTypes("GENA_AptTag:GENA_AptTag")
pointsInViews = Custom[GenericAnnotation.PointsInViews](pointList=get_area_positions, familyType=family_types, viewList=getItemAtIndex)  # Place Generic Annotation at Point In View
