# Dynamo graph UpdateGenericAnnoTagParams.dyn (Dynamo 1.0.0.1180)

# group: GET AREA PARAMETERS
categories = Categories("Areas")
all_elements_of_category = ElementsOfCategory(categories)
code_block = CodeBlock { "Area Type"; "Floor Area"; }
filterByParameterValue = Custom[List.FilterByParameterValue](Element=all_elements_of_category, parameterNameToFilter=code_block.out0, parameterValueToFilter=code_block.out1)  # Filters a List based on a given Parameter Value

# group: ANNOTATION TAG
family_types = FamilyTypes("GENA_AptTag:GENA_AptTag")
all_elements_of_family_type = ElementsOfFamilyType(family_types)

# group: Monitoring Section
watch = Watch(all_elements_of_category)
parameters = Element.Parameters(filterByParameterValue)
parameters_2 = Element.Parameters(all_elements_of_family_type)

# group: SET INVIDIVIDUAL PARAMETERS - AREA
code_block_2 = CodeBlock { "AptArea"; }
code_block_3 = CodeBlock { "Area"; }
getParameterValueByName = Element.GetParameterValueByName(element=filterByParameterValue, parameterName=code_block_3)
setParameterByName = Element.SetParameterByName(element=all_elements_of_family_type, parameterName=code_block_2, value=getParameterValueByName)

# group: SET INVIDIVIDUAL PARAMETERS - MARK
code_block_4 = CodeBlock { "AptMark"; }
code_block_5 = CodeBlock { "Name"; }
getParameterValueByName_2 = Element.GetParameterValueByName(element=filterByParameterValue, parameterName=code_block_5)
setParameterByName_2 = Element.SetParameterByName(element=all_elements_of_family_type, parameterName=code_block_4, value=getParameterValueByName_2)
