# Dynamo graph ProjectLinesOntoTopography.dyn (Dynamo 1.0.0.1180)

property_line = DSModelElementSelection()  # 1 picked in the model
curves = Element.Curves(property_line)
topography = DSModelElementSelection()  # 1 picked in the model
mesh = Topography.Mesh(topography)

# group: GET VERTICES FROM TOPOGRAPHY
vertexPositions = Mesh.VertexPositions(mesh)
faceIndices = Mesh.FaceIndices(mesh)
# note: Based on:
# http://dynamobim.org/forums/topic/topo-mesh/
A = IndexGroup.A(faceIndices)
getItemAtIndex = List.GetItemAtIndex(list=vertexPositions, index=A)
B = IndexGroup.B(faceIndices)
getItemAtIndex_2 = List.GetItemAtIndex(list=vertexPositions, index=B)
C = IndexGroup.C(faceIndices)
getItemAtIndex_3 = List.GetItemAtIndex(list=vertexPositions, index=C)
code_block = CodeBlock(a=getItemAtIndex, b=getItemAtIndex_2, c=getItemAtIndex_3) { List.Transpose({a,b,c}); }

byPerimeterPoints = Surface.ByPerimeterPoints(code_block)
byJoinedSurfaces = PolySurface.ByJoinedSurfaces(byPerimeterPoints)
ZAxis = Vector.ZAxis()
project = Curve.Project(curve=curves, baseGeometry=byJoinedSurfaces, projectionDirection=ZAxis)

# group: Re-Organize for Adaptive Component Input
flatten = Flatten(project)
startPoint = Curve.StartPoint(flatten)
endPoint = Curve.EndPoint(flatten)
create = List.Create(startPoint, endPoint)
transpose = List.Transpose(create)

family_types = FamilyTypes("LineAdaptiveComponent:LineAdaptiveComponent")
byPoints = AdaptiveComponent.ByPoints(points=transpose, familyType=family_types)
